# Grasshopper definition 2.gh (Grasshopper 1.0.7)

hexgrid = Hexagonal(Plane=PlaneXY(0, 0, 0), Size=1, ExtentX=Slider(10, range=0..10), ExtentY=Slider(20, range=0..100))  # -> flatten(Cells), Points
debrep = DeconstructBrep(Brep=hexgrid.Cells)  # -> Faces, Edges, Vertices
line = LineSDL(Start=debrep.Vertices, Direction=Vector(0, 0, 1), Length=1)
srf = Surface(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)
slx = SurfaceLine(Surface=srf, Line=line, LimitToFirst=False)  # -> Curves, Points, UVPoints, Normal
offset = OffsetSurface(Surface=srf, Distance=expr("-x", Slider(0.4, range=0..1)), Retrim=True)
offset_2 = OffsetSurface(Surface=srf, Distance=expr("-x", Slider(0.2, range=0..1)), Retrim=True)
trim = TrimTree(Tree=slx.Points, Depth=1)
srf_cp = SurfaceClosestPoint(Point=trim, Surface=offset)  # -> Point, UVPoint, Distance
srf_cp_2 = SurfaceClosestPoint(Point=trim, Surface=offset_2)  # -> Point, UVPoint, Distance
pline = PolyLine(Vertices=srf_cp_2.Point, Closed=True)
bbox = BoundingBox(Content=pline, Plane=PlaneXY(0, 0, 0))  # -> Box, Box_2
tstat = TreeStatistics(Tree=pline)  # -> Paths, Length, Count
volume = Volume(Geometry=bbox.Box)  # -> Volume, Centroid
random = Random(Range=Domain(0.2, 0.4), Number=tstat.Count, Seed=2)  # -> graft(Random)
pline_2 = PolyLine(Vertices=trim, Closed=True)  # -> simplify(Polyline)
pline_3 = PolyLine(Vertices=srf_cp.Point, Closed=True)  # -> simplify(Polyline)
scale = Scale(Geometry=pline, Center=volume.Centroid, Factor=random)  # -> simplify(Geometry), Transform
explode = Explode(Curve=pline_3, Recursive=True)  # -> simplify(Segments), Vertices
explode_2 = Explode(Curve=scale.Geometry, Recursive=True)  # -> Segments, Vertices
explode_3 = Explode(Curve=pline_2, Recursive=True)  # -> simplify(Segments), Vertices
shift = ShiftList(List=explode_2.Segments, Shift=1, Wrap=True)  # -> simplify(List)
graft = GraftTree(Tree=explode.Segments, IncludeEmptyLists=True, IncludeNullItems=True)
graft_2 = GraftTree(Tree=shift, IncludeEmptyLists=True, IncludeNullItems=True)
graft_3 = GraftTree(Tree=explode_3.Segments, IncludeEmptyLists=True, IncludeNullItems=True)
merge = Merge(Data1=graft, Data2=graft_2, Data3=graft_3)
loft = Loft(Curves=merge, Options={Adjust=False, Closed=False, LoftEnds=0, LoftSimp=0, LoftType=0, Rebuild=10, Refit=0.01})
viewer = ParamViewer(shift)
